# Grasshopper definition DH_BBoxLayout_VariablePlane.gh (Grasshopper 1.0.8)
# plug-ins: DraftHorse

# ----
# Tools for automating layout creation and modification
# 
# By Jo Kamm
# https://github.com/jkamm/DraftHorse_rh8
# DRAFTHORSE
# Example: Generate Layouts By Bounding Box (Oriented Rectangle)
# Note: face numbers only align with page numbers if no layouts exist previously
# 1. Input Geometry
dodecahedron = Data(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)

# ----
# Get Faces and Face Numbers
dodecahedron_2 = Data(dodecahedron)
debrep = DeconstructBrep(Brep=dodecahedron_2)  # -> Faces, Edges, Vertices
lng = ListLength(List=debrep.Faces)
evalsrf = EvaluateSurface(Surface=reparameterize(debrep.Faces), Point=Point(0.5, 0.5, 0))  # -> Point, Normal, UDirection, VDirection, Frame
area = Area(Geometry=debrep.Faces)  # -> Area, Centroid
series = Series(Start=1, Step=1, Count=lng)
pl_origin = PlaneOrigin(Base=evalsrf.Frame, Origin=area.Centroid)
pln_perface = Data(pl_origin)
int_indices = Data(series)

# ----
# Upscale for margin around Geometry
number_slider = Slider(1.1, range=0..10)
dodecahedron_3 = Data(dodecahedron)
scale = Scale(Geometry=dodecahedron_3, Center=Point(0, 0, 0), Factor=number_slider)  # -> Geometry, Transform
geo_upscaled = Data(scale.Geometry)

# ----
# Display Geo and Face Numbers
pln_perface_2 = Data(pln_perface)
int_indices_2 = Data(int_indices)
dodecahedron_4 = Data(dodecahedron)

preview = CustomPreview(
    Geometry=dodecahedron_4,
    Material={diffuse=RGB(221, 160, 221), emission=RGB(66, 48, 66), shine=0.5, specular=RGB(255, 255, 255), transparency=0})
tag = TextTag3D(Location=pln_perface_2, Text=int_indices_2, Size=1, Colour=ColourSwatch(SwatchColor=RGB(0, 0, 255)), Justification=5)

# ----
# 2. Generate Layouts Per Face
int_indices_3 = Data(int_indices)
geo_upscaled_2 = Data(geo_upscaled)
pln_perface_3 = Data(pln_perface)
bbox = BoundingBox(Content=graft(geo_upscaled_2), Plane=graft(pln_perface_3))  # -> Box, Box_2
bbox_layout = LayoutByBounds(Name=graft(int_indices_3), BBox=bbox.Box, Scale=1, Units=False)

# ----
# 3. Check Output by Layout
pln_perface_4 = Data(pln_perface)
number_slider_2 = Slider(0, range=0..10)
pages = QueryPages(AutoUpdateState=True)
item = ListItem(List=flatten(pln_perface_4), Index=number_slider_2, Wrap=True)
item_2 = ListItem(List=flatten(pages), Index=number_slider_2, Wrap=True)
active_page = MakePageActive(Run=Toggle(True), Page=item_2)  # -> Result, Name
dec_layout = DeconstructLayoutPage(Layout=item_2)  # -> PageNumber, PageName, Details, Width, Height, Units
tag_2 = TextTag3D(Location=item, Text=dec_layout.PageNumber, Size=1, Colour=ColourSwatch(SwatchColor=RGB(0, 255, 255)), Justification=5)

# ----
# 4. Delete Layouts (as needed)
pages_2 = QueryPages(AutoUpdateState=True)
deletelayout = DeleteLayout(Page=flatten(pages_2), Override=False)
