# Grasshopper definition DH_Details_ByRelativeView_Example.gh (Grasshopper 1.0.8)
# plug-ins: DraftHorse

pln_boxorigin = Plane(Plane(origin=(8.594654416, 9.847133255, 0), x=(0.9036334152, -0.4283067252, 0), y=(0.4283067252, 0.9036334152, 0)))

# ----
# DRAFTHORSE
# Example: Create/Modify Details using Relative Views
# 1.Create Empty Layout
panel = Panel("NewLayout")
# Tools for automating layout creation and modification
# 
# By Jo Kamm
# https://github.com/jkamm/DraftHorse_rh8
newlayout = CreateNewLayout(Name=panel, Height=11, Width=17, Details="0", Scale=1, Units=0)
page_newlayout = Data(newlayout)

box = DomainBox(Base=pln_boxorigin, X=Slider(2, range=0..10), Y=Slider(7, range=0..10), Z=Slider(10, range=0..10))
pln_boxorigin_2 = Data(pln_boxorigin)
B = Data(box)

# ----
# Generate Rectangles for Details
page_newlayout_2 = Data(page_newlayout)
number_slider = Slider(2, range=0..10)
dec_layout = DeconstructLayoutPage(Layout=page_newlayout_2)  # -> PageNumber, PageName, Details, Width, Height, Units
rectangle = Rectangle(Plane=PlaneXY(0, 0, 0), XSize=dec_layout.Width, YSize=dec_layout.Height, Radius=0)  # -> Rectangle, Length
range = Range(Domain=dec_layout.Width, Steps=number_slider)
range_2 = Range(Domain=dec_layout.Height, Steps=number_slider)
consec = ConsecutiveDomains(Numbers=range_2, Additive=False)
consec_2 = ConsecutiveDomains(Numbers=range, Additive=False)
dom² = ConstructDomain²(DomainU=consec_2, DomainV=graft(consec))
subsrf = Isotrim(Surface=rectangle.Rectangle, Domain=dom²)
neg = Negative(Value=Slider(0.5, range=0..1))
offset = OffsetCurve(Curve=subsrf, Distance=neg, Corners=1)  # -> flatten(Curve)
rec_detailboundaries = Rectangle(reverse(offset))

# ----
# Generate Rectangles As Views (relative to Bounding Box)
pln_boxorigin_3 = Data(pln_boxorigin_2)
B_2 = Data(B)
bbox = BoundingBox(Content=B_2, Plane=pln_boxorigin_3, UnionBox=True)  # -> Box, Box_2
box_corners = BoxCorners(Box=bbox.Box)  # -> CornerA, CornerB, CornerC, CornerD, CornerE, CornerF, CornerG, CornerH
rec_3pt = Rectangle3Pt(PointA=box_corners.CornerA, PointB=box_corners.CornerB, PointC=box_corners.CornerE)  # -> Rectangle, Length
rec_3pt_2 = Rectangle3Pt(PointA=box_corners.CornerB, PointB=box_corners.CornerC, PointC=box_corners.CornerF)  # -> Rectangle, Length
rec_3pt_3 = Rectangle3Pt(PointA=box_corners.CornerE, PointB=box_corners.CornerF, PointC=box_corners.CornerH)  # -> Rectangle, Length
rec_3pt_4 = Rectangle3Pt(PointA=box_corners.CornerD, PointB=box_corners.CornerB, PointC=box_corners.CornerG)  # -> Rectangle, Length
rec_perspective = Rectangle(rec_3pt_4.Rectangle)
rec_front = Rectangle(rec_3pt.Rectangle)
rec_right = Rectangle(rec_3pt_2.Rectangle)
rec_top = Rectangle(rec_3pt_3.Rectangle)
pln = Plane(rec_perspective)
merge = Merge(Data1=rec_front, Data2=rec_right, Data3=rec_top)
pt = PointOriented(BasePlane=pln, UComponent=0, VComponent=0, WComponent=Slider(10, range=0..10))
m2d_parallel = Make2DParallelView(Projection=merge)
m2d_perspective = Make2DPerspectiveView(Camera=pt, Frame=rec_perspective)
merge_2 = Merge(Data1=m2d_parallel, Data2=m2d_perspective)
view_4views = Data(merge_2)

# ----
# largest BB dimension
# detail dims
pln_boxorigin_4 = Data(pln_boxorigin_2)
# Find nearest scale that fits largest dimension of target's bounding box
B_3 = Data(B)
rec_detailboundaries_2 = Rectangle(rec_detailboundaries)
bbox_2 = BoundingBox(Content=B_3, Plane=pln_boxorigin_4, UnionBox=True)  # -> Box, Box_2
debox = DeconstructBox(Box=graft(rec_detailboundaries_2))  # -> Plane, X, Y, Z
debox_2 = DeconstructBox(Box=bbox_2.Box)  # -> Plane, X, Y, Z
num = Number([debox_2.X, debox_2.Y, debox_2.Z])
num_2 = Number([debox.X, debox.Y])
panel_2 = Panel(num_2)
bnd = Bounds(Numbers=num)
panel_3 = Panel(num)
dedomain = DeconstructDomain(Domain=bnd)  # -> Start, End
division = Division(A=num_2, B=dedomain.End)
panel_4 = Panel(division)
bnd_2 = Bounds(Numbers=flatten(division))
dedomain_2 = DeconstructDomain(Domain=bnd_2)  # -> Start, End

# ----
# 2. Add details to Layout
page_newlayout_3 = Data(page_newlayout)
add_details = Button()
rec_detailboundaries_3 = Rectangle(rec_detailboundaries)
view_4views_2 = Data(view_4views)
box_target = Data(B)
pick_display = Display({"Wireframe", "Shaded", "Rendered", "Ghosted", "X-Ray", "Technical", "Artistic", "Pen", "Monochrome", "Arctic", "Raytraced"}, selected="Wireframe")
number_slider_2 = Slider(0.5, range=0..1)
newdetail = NewDetail(
    Run=add_details,
    LayoutPage=page_newlayout_3,
    Bounds=rec_detailboundaries_3,
    Display=pick_display,
    Target=box_target,
    Scale=1,
    Projection=0,
    View=view_4views_2)  # -> Result, Detail, Display, Target, Scale, Projection, View
panel_5 = Panel(newdetail.Detail)
panel_6 = Panel(newdetail.Display)
panel_7 = Panel(newdetail.Projection)

c_units = ConvertUnits(Data=1, Source=2, Target=1)

# ----
# List of scales
# This example assumes Model and Page units are inches.
# Scale will need adjustment for metric units
series = Series(Start="-4", Step=1, Count=10)
_2º = PowerOf2(Value=series)

consec_3 = ConsecutiveDomains(Numbers=_2º, Additive=False)
fdom = FindDomain(Domains=consec_3, Number=dedomain_2.Start, Strict=False)  # -> Index, Neighbour
item = ListItem(List=_2º, Index=fdom.Index, Wrap=True)
multiplication = Multiplication(A=c_units, B=item)
num_closestscale = Data(multiplication)

# ----
# 3. Modify details
# The "Query Pages" Component (native to gh8)
# updates dynamically when layout pages are
# created or destroyed.
# Components which modify Rhino pages can
# cause an update loop - turn off "Synchronize"
# on the Query Pages component to stop/avoid
page_newlayout_4 = Data(page_newlayout)
box_target_2 = Data(B)
edit_details = BooleanToggle(False)
dec_layout_2 = DeconstructLayoutPage(Layout=page_newlayout_4)  # -> PageNumber, PageName, Details, Width, Height, Units
pick_display_2 = Display({"Wireframe", "Shaded", "Rendered", "Ghosted", "X-Ray", "Technical", "Artistic", "Pen", "Monochrome", "Arctic", "Raytraced"}, selected="Wireframe")
pages = QueryPages(Name=dec_layout_2.PageName, AutoUpdateState=False)
num_closestscale_2 = Data(num_closestscale)
dec_layout_3 = DeconstructLayoutPage(Layout=pages)  # -> PageNumber, PageName, Details, Width, Height, Units
detailedit = EditDetails(
    Run=edit_details,
    Detail=dec_layout_3.Details,
    Display=pick_display_2,
    Target=box_target_2,
    Scale=flatten(Slider(1, range=0..1)))  # -> Result, Detail, Display, Target, Scale, Projection, View
panel_8 = Panel(detailedit.Display)
panel_9 = Panel(detailedit.Result)
panel_10 = Panel(detailedit.View)
