# Grasshopper definition DH_DocumentAndLayoutText_Example.gh (Grasshopper 1.0.8)
# plug-ins: RhinoCodePluginGH, DraftHorse

edit_layout_text_text_on_layout = Button()

# ----
# Tools for automating layout creation and modification
# 
# By Jo Kamm
# https://github.com/jkamm/DraftHorse_rh8
# DRAFTHORSE
# Use with DH_DocumentAndLayoutText_Example.3dm
# Access/Edit Document Text
# for consistent project data across layouts
# note: document text keys starting
# with '.' are hidden from the user
edit_doc_text = Button()
ghdocpath = Script()  # -> dir
# ---------- ghdocpath: C# ----------
// Grasshopper Script Instance
using System;
using System.Collections;
using System.Collections.Generic;
using System.Drawing;

using Rhino;
using Rhino.Geometry;

using Grasshopper;
using Grasshopper.Kernel;
using Grasshopper.Kernel.Data;
using Grasshopper.Kernel.Types;

public class Script_Instance : GH_ScriptInstance
{
  /* 
    Members:
      RhinoDoc RhinoDocument
      GH_Document GrasshopperDocument
      IGH_Component Component
      int Iteration

    Methods (Virtual & overridable):
      Print(string text)
      Print(string format, params object[] args)
      Reflect(object obj)
      Reflect(object obj, string method_name)
  */
  
  private void RunScript(ref object dir)
  {
    string filePath = GrasshopperDocument.FilePath;
    dir = filePath;
  }
}
# ---------- end ghdocpath ----------
filter = StreamFilter(Gate=edit_doc_text, Stream0="GrasshopperFilePath")
accessdoctext = AccessDocumentText(Key=filter)
specific_doc_text_value = Panel(accessdoctext)

editdoctext = EditDocumentText(Run=edit_doc_text, Keys="GrasshopperFilePath", Values=ghdocpath, WriteMethod="Merge")  # -> Keys, Values

doc_text_keys = Panel(editdoctext.Keys)
doc_text_values = Panel(editdoctext.Values)

# ----
# See Layout Template for use of Text Fields with Document and Layout Text
# primary use of this component is for
# programmatic baking to Layouts
# (use in combination with Bake component
# from Elefront, Human, or other plugin set)
make_layout_active_if_it_isn_t_already = Button()

# ----
# Access/Edit Layout Text
# for layout specific data
# Note "Page Title" Text on Layout before pressing
# (As well as text in the title block)
# "Edit Layout" Used here
# only to access Layout attributes
layout = PageLayout(<page layout referenced from the Rhino model>)
newvalues = Panel("""1:1
3/4 Baltic Birch
10
Kitchen Casework
1""")

layout_2 = PageLayout(layout)
active_page = MakePageActive(Run=make_layout_active_if_it_isn_t_already, Page=layout_2)  # -> Result, Name

layoutedit = EditLayout(LayoutPage=layout)  # -> LayoutPage, Index, Name, Width, Height, Keys, Values
layout_3 = PageLayout(layout)

# ----
# And Edit Named Text Objects on a Layout
panel = Panel("Hello World!")
lotext = ModifyText(Run=edit_layout_text_text_on_layout, LayoutPage=layout_3, Name="PageTitle", Text=panel)

item = ListItem(List=layoutedit.Keys, Index=0, Wrap=True)
layoutedit_2 = EditLayout(Run=edit_layout_text_text_on_layout, LayoutPage=layout, Keys=layoutedit.Keys, Values=newvalues)  # -> LayoutPage, Index, Name, Width, Height, Keys, Values
values = Panel(layoutedit.Values)
keys = Panel(layoutedit.Keys)

getlovalue = AccessLayoutUserText(Page=layout, Keys=item)

specific_value = Panel(getlovalue)
