# Grasshopper definition DH_NewLayout_Example.gh (Grasshopper 1.0.8)
# plug-ins: DraftHorse

# ----
# DRAFTHORSE
# 1. Create New Layout
number_slider = Slider(4, range=0..10)
# Tools for automating layout creation and modification
# 
# By Jo Kamm
# https://github.com/jkamm/DraftHorse_gh
newlayout = CreateNewLayout(Height=11, Width=17, Details=number_slider, Scale=1, Units=0)
dec_layout = DeconstructLayoutPage(Layout=newlayout)  # -> PageNumber, PageName, Details, Width, Height, Units
guid_details = Data(dec_layout.Details)

pt = Point(Point(10, 10, 10))
box = DomainBox(Base=pt, X=Slider(2, range=0..10), Y=Slider(3, range=0..10), Z=Slider(4, range=0..10))
box_target = Data(box)

# ----
# 2. Modify details to display geometry
guid_details_2 = Data(guid_details)
box_target_2 = Data(box_target)
detailedit = EditDetails(
    GUID=guid_details_2,
    Display=<geometry referenced from the Rhino model>,
    Target=box_target_2,
    Scale=Slider(1, range=0..1))  # -> Result, GUID, Display, Target, Scale, Projection, View
panel = Panel(detailedit.Result)
