# Grasshopper definition DH_ReferenceLayouts_Example.gh (Grasshopper 1.0.8)
# plug-ins: DraftHorse

# ----
# DRAFTHORSE
# 1. Generate (or select)
# template to copy
panel = Panel("Template")
# Tools for automating layout creation and modification
# 
# By Jo Kamm
# https://github.com/jkamm/DraftHorse_gh
newlayout = CreateNewLayout(Name=panel, Height=11, Width=17, Details=4, Scale=1, Units=0)

# ----
# 2. Copy Existing Layout
new_layout_names = Panel("""Part1
Part2
Part3
Part4
Copy
Copy
Copy""")
copylayout = CopyLayout(Template=newlayout, NewName=new_layout_names)

# ----
# 3. Delete unwanted layouts.
# Warning message window
# can be turned off from the
# component menu
pages = QueryPages(AutoUpdateState=True)
# 4. Query Pages automatically updates
# after changes to the Rhino Document
# (if "Synchronise" is on)
deletelayout = DeleteLayout(Page=flatten(pages), Override=False)

# ----
# In DraftHorse in  Rhino 8, Layouts are referenced by the native "Model Page View" in Grasshopper.
# To get these, use the "query Page Views" component or the Layout Pages Parameter
# Be careful of layouts with the same name.
# Layouts have unique index numbers
# (same as the order in the Rhino document)
pages_2 = QueryPages(Name=new_layout_names, AutoUpdateState=True)

layout = PageLayout(pages_2)

dec_layout = DeconstructLayoutPage(Layout=layout)  # -> PageNumber, PageName, Details, Width, Height, Units

panel_2 = Panel(dec_layout.PageName)
panel_3 = Panel(dec_layout.PageNumber)
