# Grasshopper definition DH_CopySortPrint_ZUI_Example.gh (Grasshopper 1.0.8)
# plug-ins: DraftHorse

# ----
# Tools for automating layout creation and modification
# 
# By Jo Kamm
# https://github.com/jkamm/DraftHorse_gh
# DRAFTHORSE
# 1. Create layout template
# (or use existing)
panel = Panel("Template")
newlayout = CreateNewLayout(Name=panel, Height=11, Width=17, Details=4, Scale=1, Units=0)

# ----
# 2. Duplicate template
new_layout_names = Panel("""Part1
Part2
Part3
Part4""")
copylayout = CopyLayout(Template=newlayout, NewName=new_layout_names)

# ----
# 3. Get layouts
pages = QueryPages(Name=new_layout_names, AutoUpdateState=True)

# ----
# 4. Print layouts to PDF
# All in one document
# Separate documents
# by layout name
export_pdfs = Button()
graft = GraftTree(Tree=pages, IncludeEmptyLists=True, IncludeNullItems=True)
current_dir = Script()  # -> dir
# ---------- current_dir: C# ----------
// Grasshopper Script Instance
using System;
using System.Collections;
using System.Collections.Generic;
using System.Drawing;

using Rhino;
using Rhino.Geometry;
using System.IO;
using Grasshopper;
using Grasshopper.Kernel;
using Grasshopper.Kernel.Data;
using Grasshopper.Kernel.Types;

public class Script_Instance : GH_ScriptInstance
{
  /* 
    Members:
      RhinoDoc RhinoDocument
      GH_Document GrasshopperDocument
      IGH_Component Component
      int Iteration

    Methods (Virtual & overridable):
      Print(string text)
      Print(string format, params object[] args)
      Reflect(object obj)
      Reflect(object obj, string method_name)
  */
  
  private void RunScript(ref object dir)
  {
    string filePath = GrasshopperDocument.FilePath;
    dir = Path.GetDirectoryName(filePath);
  }
}
# ---------- end current_dir ----------
dh_pdf = PDFLayout(
    Run=export_pdfs,
    Pages=flatten(pages),
    Folder=current_dir,
    Filename="AllParts",
    DPI=100,
    ColorMode=0,
    UsePrintWidths=True,
    WireScale=1,
    RasterVector=False)

dec_layout = DeconstructLayoutPage(Layout=graft)  # -> PageNumber, PageName, Details, Width, Height, Units
dh_pdf_2 = PDFLayoutZUI(Run=export_pdfs, LayoutPage=flatten(pages), Folder=current_dir, FileName="AllParts")
dh_pdf_3 = PDFLayout(
    Run=export_pdfs,
    Pages=pages,
    Folder=current_dir,
    Filename=dec_layout.PageName,
    DPI=100,
    ColorMode=0,
    UsePrintWidths=True,
    WireScale=1,
    RasterVector=False)  # disabled

panel_2 = Panel(dh_pdf_3)
panel_3 = Panel(dh_pdf_2)
