# Grasshopper definition DH_ModifyLayout_ZUI.gh (Grasshopper 1.0.8)
# plug-ins: DraftHorse

# DRAFTHORSE
# Example: Modify Layout Attributes
number_slider = Slider(10, range=0..10)

# ----
# Tools for automating layout creation and modification
# 
# By Jo Kamm
# https://github.com/jkamm/DraftHorse_gh
# 1. Create a Generic Layout
newlayout = CreateNewLayoutZUI(Paper=1, Landscape=True, Width=17, Height=11, Details=4, Scale=1, Units=0)

# ----
# 2. Write to some or all Layout Attributes
layout = PageLayout(newlayout)
edit_layout = Button()
keys = Panel("""Key1
Key2""")
values_length_must_match_keys = Panel("""Value1
Value2""")
layoutedit = EditLayout2(
    Run=edit_layout,
    LayoutPage=layout,
    Name="NewLayoutName",
    Width=Slider(20, range=0..100),
    Height=Slider(20, range=0..100),
    Keys=keys,
    Values=values_length_must_match_keys)  # -> LayoutPage, Index, Name, Width, Height, Keys, Values
keys_2 = Panel([layoutedit.LayoutPage, layoutedit.Index, layoutedit.Name, layoutedit.Width, layoutedit.Height, layoutedit.Keys, layoutedit.Values])
